# Grasshopper definition GRASSHOPPER - BRISE SOLEIL.gh (Grasshopper 1.0.8)
# plug-ins: Human

brise_soleil_geometry = Geometry(<curve referenced from the Rhino model>)
reference_point = Geometry(<point referenced from the Rhino model>)
geo = Geometry(<extrusion referenced from the Rhino model>)
scale = Scale(Geometry=brise_soleil_geometry, Center=reference_point, Factor=Slider(0.8, range=0..1))  # -> Geometry, Transform
divide = DivideDomain²(Domain=geo, UCount=Slider(22, range=0..100), VCount=Slider(1, range=0..1))
Z = UnitZ(Factor=Slider(1, range=0..1))
subsrf = Isotrim(Surface=geo, Domain=divide)
edgesdir = EdgesFromDirections(Brep=subsrf, Directions=Z, Reflex=True, Angle=0)  # -> Edges, Indices, Map
item = ListItem(List=edgesdir.Edges, Index=Slider(1, range=0..1), Wrap=True)  # -> flatten(Item)
end = EndPoints(Curve=item)  # -> Start, End
graft = GraftTree(Tree=item, IncludeEmptyLists=True, IncludeNullItems=True)
vec2pt = Vector2Pt(PointA=reference_point, PointB=end.Start, Unitize=False)  # -> Vector, Length
move = Move(Geometry=scale.Geometry, Motion=vec2pt.Vector)  # -> Geometry, Transform
rotax = RotateAxis(Geometry=move.Geometry, Angle=Slider(2.6, range=0..10), Axis=item)  # -> graft(Geometry), Transform
swp1 = Sweep1(Rail=graft, Sections=rotax.Geometry, Miter=1)  # -> flatten(Brep)
layer = ModelLayer(Name="BRISE SOLEIL A")  # -> Layer, Name, Hidden, Locked, DisplayColour, Material, Linetype
bake = BakeGeometry(Bake=Toggle(True), Geometry=swp1, Attributes=layer.Layer, DeleteOldBakes=False, PreserveTrees=False)
