# Grasshopper definition GRASSHOPPER - POSITIONING PEDREGULHO.gh (Grasshopper 1.0.8)

geometry_to_be_moved = Geometry(<brep referenced from the Rhino model>)
reference_axis = Geometry(<curve referenced from the Rhino model>)
eixos = Geometry([<curve referenced from the Rhino model> x14])
end = EndPoints(Curve=reference_axis)  # -> Start, End
end_2 = EndPoints(Curve=eixos)  # -> Start, End
vec2pt = Vector2Pt(PointA=end.Start, PointB=end.End, Unitize=False)  # -> Vector, Length
vec2pt_2 = Vector2Pt(PointA=end_2.Start, PointB=end_2.End, Unitize=False)  # -> Vector, Length
geo = Geometry(end.Start)
geo_2 = Geometry(end_2.Start)
vec2pt_3 = Vector2Pt(PointA=end.Start, PointB=geo_2, Unitize=False)  # -> Vector, Length
angle = Angle(VectorA=vec2pt_2.Vector, VectorB=vec2pt.Vector)  # -> Angle, Reflex
move = Move(Geometry=geometry_to_be_moved, Motion=vec2pt_3.Vector)  # -> Geometry, Transform
Z = UnitZ(Factor=1)
neg = Negative(Value=angle.Angle)
rot3d = Rotate3D(Geometry=move.Geometry, Angle=angle.Angle, Center=geo_2, Axis=Z)  # -> Geometry, Transform
