# Grasshopper definition gh_musharabya.gh (Grasshopper 1.0.8)
# plug-ins: Human

geo = Geometry(<extrusion referenced from the Rhino model>)
X = UnitX(Factor=1)
Z = UnitZ(Factor=1)
edgesdir = EdgesFromDirections(Brep=geo, Directions=Z, Reflex=True, Angle=0)  # -> Edges, Indices, Map
edgesdir_2 = EdgesFromDirections(Brep=geo, Directions=X, Reflex=True, Angle=0)  # -> Edges, Indices, Map
item = ListItem(List=edgesdir.Edges, Index=0, Wrap=True)
item_2 = ListItem(List=edgesdir_2.Edges, Index=0, Wrap=True)
number_slider = Slider(0.15, range=0..1)
len = Length(Curve=item)
len_2 = Length(Curve=item_2)
division = Division(A=len, B=number_slider)
division_2 = Division(A=len_2, B=number_slider)
round = Round(Number=division)  # -> Nearest, Floor, Ceiling
round_2 = Round(Number=division_2)  # -> Nearest, Floor, Ceiling
divide = DivideDomain²(Domain=geo, UCount=round_2.Nearest, VCount=round.Nearest)
subsrf = Isotrim(Surface=geo, Domain=divide)
area = Area(Geometry=subsrf)  # -> Area, Centroid
scale = Scale(Geometry=subsrf, Center=area.Centroid, Factor=Slider(0.9, range=0..1))  # -> Geometry, Transform
sdiff = SolidDifference(BrepsA=geo, BrepsB=scale.Geometry)
Y = UnitY(Factor=Slider(0.15, range=0..1))
extr = Extrude(Base=sdiff, Direction=Y)
bake = BakeGeometry(Bake=Toggle(True), Geometry=extr, DeleteOldBakes=False, PreserveTrees=False)
